# Grasshopper definition Facade_Manager_GH_v0.2.gh (Grasshopper 1.0.7)
# plug-ins: Pufferfish, MeshEdit Components, Human, Weaverbird

# Step 3: Set Configuration
number_slider = Slider(16.2, range=0..100)

# ----
# Step 1: Input Mass
# Mass
# Layer
# Facade Thickness
# Step 2 : Set Grid
number_slider_2 = Slider(0, range=0..2)
# Parameters Facade
pipeline = GeometryPipeline(
    GroupByLayer=False,
    GroupByType=False,
    IncludeHidden=True,
    IncludeLocked=True,
    LayerFilter="Simple_Volume::mass",
    NameFilter="*",
    SublayerFiltering=True,
    TypeFilter=1073741848)

# ----
# Step 4: Preview Model
list = ValueList({"Mesh Type": 0, "Mesh Heights": 1, "Mesh Accuracy": 2, "Hide Mesh": 3}, selected="Mesh Type")
gate = StreamGate(Stream=list, Gate=list)  # -> Target0, Target1, Target2, Target3
replace = ReplaceItems(List=gate.Target0, Item=True, Indices=0, Wrap=False)  # -> flatten(List)
replace_2 = ReplaceItems(List=gate.Target1, Item=True, Indices=0, Wrap=False)  # -> flatten(List)
replace_3 = ReplaceItems(List=gate.Target2, Item=True, Indices=0, Wrap=False)  # -> flatten(List)

# ----
# Choose Family
# North
# East
# South
# West
list_2 = ValueList({"A", "B", "C", "D", "E", "F", "G", "H", "Z"}, selected="C")
list_3 = ValueList({"A", "B", "C", "D", "E", "F", "G", "H", "Z"}, selected="D")
list_4 = ValueList({"A", "B", "C", "D", "E", "F", "G", "H", "Z"}, selected="A")
list_5 = ValueList({"A", "B", "C", "D", "E", "F", "G", "H", "Z"}, selected="C")

# ----
# Corner Blocks
toggle = BooleanToggle(False)

# ----
# Configuration Type
list_6 = ValueList({"Simple": 0, "Ends": 1, "Checker Board": 2, "Alternate Horizontal": 3, "Alternate Vertical": 4, "Attractor": 5, "Random": 6, "Orientation": 7}, selected="Random")

# ----
# Scale Blocks
# X Direction
# Y Direction
toggle_2 = BooleanToggle(True)

# ----
# Grid Type
list_7 = ValueList({"Normal Grid": 0, "Shifted Grid": 1, "Existing Grid": 2}, selected="Shifted Grid")

# ----
# Grid Size
list_8 = ValueList({"1/3", "1/2": 0.5, "1", "2", "3", "4", "5", "6"}, selected="1/2")
multiplication = Multiplication(A=number_slider, B=list_8)
panel_target_width = Panel(multiplication)

# ----
# Existing Grid
pipeline_2 = GeometryPipeline(
    GroupByLayer=False,
    GroupByType=False,
    IncludeHidden=True,
    IncludeLocked=True,
    LayerFilter="00_Guide::Grid",
    NameFilter="*",
    SublayerFiltering=True,
    TypeFilter=4)
data = Data(pipeline_2)

# ----
# Step 5: Bake and check Blocks
# Bake Facade
button = Button()

# ----
# Attractor Setting
# Direction Attractor
# Get Attractor
# Attractor Power
pipeline_3 = GeometryPipeline(
    GroupByLayer=False,
    GroupByType=False,
    IncludeHidden=True,
    IncludeLocked=True,
    LayerFilter="02_Facade::Facade_Blocks::crv",
    NameFilter="*",
    SublayerFiltering=True,
    TypeFilter=1073741852)
list_9 = ValueList({"Dir1": 0, "Dir2": 1}, selected="Dir1")

# ----
# Facade Thicknes Preperation
data_2 = Data(pipeline)
sort_surfaces = SortSurfaces(B=data_2, custom_order=0)  # -> lowest_2, highest_2, custom_2, remove_cap_2
evalsrf = EvaluateSurface(Surface=reparameterize(sort_surfaces.highest_2), Point="{0.5,0.5,0}")  # -> Point, Normal, UDirection, VDirection, Frame
evalsrf_2 = EvaluateSurface(Surface=reparameterize(sort_surfaces.lowest_2), Point="{0.5,0.5,0}")  # -> Point, Normal, UDirection, VDirection, Frame
debrep = DeconstructBrep(Brep=sort_surfaces.highest_2)  # -> Faces, Edges, Vertices
join = JoinCurves(Curves=debrep.Edges, Preserve=False)  # -> simplify(Curves)
offcrv = OffsetCurve(Curve=simplify(join), Distance=number_slider_2, Plane=PlaneXY(0, 0, 0), BothSides=True, Kinks=0, CapType=1)
lng = ListLength(List=data_2)
tstat = TreeStatistics(Tree=offcrv)  # -> Paths, Length, Count
pshift = ShiftPaths(Data=offcrv, Offset=-1)
dist = Distance(PointA=evalsrf.Point, PointB=evalsrf_2.Point)
larger = LargerThan(FirstNumber=tstat.Count, SecondNumber=lng)  # -> LargerThan, OrEqualTo
filter = StreamFilter(Gate=larger.LargerThan, Stream0=offcrv, Stream1=pshift)
Z = UnitZ(Factor=dist)
division = Division(A=dist, B=Slider(2, range=0..10))
curvepoint = PointOnCurve(filter, parameter=0.5)
Z_2 = UnitZ(Factor=division)
neg = Negative(Value=Z_2)
move = Move(Geometry=curvepoint, Motion=neg)  # -> Geometry, Transform
data_3 = Data(simplify(move.Geometry))
match = MatchTree(Tree=data_3, Guide=filter)  # -> simplify(Tree)
brepinc = PointInBrep(Brep=graft(data_2), Point=match, Strict=False)  # -> simplify(Inside)
cull = CullPattern(List=filter, CullPattern=brepinc)
data_4 = Data(cull)
neg_2 = Negative(Value=Z)  # -> simplify(Result)
boundary = BoundarySurfaces(Edges=data_4)
extr = Extrude(Base=boundary, Direction=neg_2)
data_5 = Data(extr)

panel = Panel(brepinc)

# ---- group: Masses Offset
cap = CapHoles(Brep=data_5)  # -> flatten(Brep)

# ----
viewer = ParamViewer(cap)

# ----
# Existing Grid
number_slider_3 = Slider(500, range=0..1000)
data_6 = Data(data)
Z_3 = UnitZ(Factor=number_slider_3)
extr_2 = Extrude(Base=data_6, Direction=Z_3)
lng_2 = ListLength(List=data_2)
python = GhPythonScript(x=lng_2)  # -> a
# ---------- python: Python ----------
__author__ = "MTS"
__version__ = "2021.03.23"

import rhinoscriptsyntax as rs
if (x==1):
    a=0
else:
    a=1
# ---------- end python ----------

# ----
# Shifted Grid
number_slider_4 = Slider(2, range=0..10)
pl = ConstructPlane(Origin=Point(0, 0, 0), XAxis=Vector(1, 0, 0), YAxis=Vector(0, 1, 0))
lng_3 = ListLength(List=data_2)
larger_2 = LargerThan(FirstNumber=lng_3, SecondNumber=Slider(1, range=0..1))  # -> LargerThan, OrEqualTo

# ----
# Normal Grid
number_slider_5 = Slider(0.1, range=0..0.1)
tstat_2 = TreeStatistics(Tree=data_2)  # -> Paths, Length, Count
larger_3 = LargerThan(FirstNumber=tstat_2.Length, SecondNumber=Slider(1, range=0..1))  # -> LargerThan, OrEqualTo

# ----
# Panalizer
# Preperation to group Buildings
brep = Brep(simplify(cap))
data_7 = Data(brep)
number_slider_6 = Slider(0.1, range=0..0.1)
volume = Volume(Geometry=data_7)  # -> Volume, Centroid
project = Project(Geometry=volume.Centroid, Plane=PlaneXY(0, 0, 0))  # -> Geometry, Transform
pgroups = PointGroups(Points=project.Geometry, Distance=Slider(10, range=0..10))  # -> Groups, Indices
item = ListItem(List=data_7, Index=pgroups.Indices, Wrap=True)  # -> simplify(Item)

# ---- group: Creat Grid / Use Existing Grid
gate_2 = StreamGate(Stream=brep, Gate=0)  # -> Target0, Target1

# ----
area = Area(Geometry=item)  # -> Area, Centroid

pdecon = Deconstruct(Point=area.Centroid)  # -> XComponent, YComponent, ZComponent
sort = SortList(Keys=pdecon.ZComponent, ValuesA=item)  # -> Keys, ValuesA
brep_2 = Brep(simplify(sort.ValuesA))
box_properties = BoxProperties(B=brep_2)  # -> out, xDim, yDim, zDim, bBasePt, bTopPoint, bCentre, bPts; inputs B: Box
# ---------- box_properties: Python ----------
"""
 A small utility to get some basic box properties
"""
import Rhino

"""
inputs:
    B= a or lisst of boxes (item access)

Outputs:
    xDim=   width of the box
    yDim= length of the box
    zDim= Height of the box
    
    bBasePointt= lowest point of the box (min x,y,z values)
    bTopPoint= highest point of the box (max x,y,z values)
    bCentre= centre point of the box
"""

ghenv.Component.Name = "Box Properties"
ghenv.Component.NickName = "Box Properties"

# Keep it in the "Performing" tab
ghenv.Component.Category = "Performing"

# Define the subcategory

#ghenv.Component.SubCategory = "1 Automation"
ghenv.Component.SubCategory = "2 Geometry"
#ghenv.Component.SubCategory = "3 Environmental"

try:
    
    xDim=B.X[1]-B.X[0]
    yDim=B.Y[1]-B.Y[0]
    zDim=B.Z[1]-B.Z[0]
    
    bBasePt=Rhino.Geometry.Point3d(B.X[0],B.Y[0],B.Z[0])
    bTopPoint=Rhino.Geometry.Point3d(B.X[1],B.Y[1],B.Z[1])
    
    bCentre=B.Center

except:
    print "please insert one or more valid bounding boxes as input"
# ---------- end box_properties ----------
xy = XYPlane(Origin=box_properties.bCentre)
sec = BrepPlane(Brep=brep_2, Plane=xy)  # -> Curves, Points
division_2 = Division(A=box_properties.zDim, B=2)
pshift_2 = ShiftPaths(Data=sec.Curves, Offset=-1)  # -> simplify(Data)
Z_4 = UnitZ(Factor=division_2)
neg_3 = Negative(Value=Z_4)
move_2 = Move(Geometry=pshift_2, Motion=neg_3)  # -> Geometry, Transform

# ---- group: Normal Grid / Shifted Grid / Existing Grid
gate_3 = StreamGate(Stream=move_2.Geometry, Gate=list_7)  # -> simplify(Target0), simplify(Target1), simplify(Target2)

# ----
explode = Explode(Curve=gate_3.Target0, Recursive=True)  # -> Segments, Vertices
move_3 = Move(Geometry=pshift_2, Motion=Z_4)  # -> Geometry, Transform
explode_2 = Explode(Curve=move_3.Geometry, Recursive=True)  # -> simplify(Segments), Vertices
len = Length(Curve=explode.Segments)
curvepoint_2 = PointOnCurve(explode.Segments, parameter=0.5)
curvepoint_3 = PointOnCurve(explode_2.Segments, parameter=0.507)
division_3 = Division(A=len, B=panel_target_width)
dist_2 = Distance(PointA=curvepoint_2, PointB=curvepoint_3)
int = Integer(division_3)
item_2 = ListItem(List=dist_2, Index=0, Wrap=True)
divide = DivideCurve(Curve=explode.Segments, Count=int, Kinks=False)  # -> Points, Tangents, Parameters
pshift_3 = ShiftPaths(Data=divide.Points, Offset=-1)
pt = Point(pshift_3)
shift = ShiftList(List=pt, Shift=1, Wrap=False)
shift_2 = ShiftList(List=pt, Shift=-1, Wrap=False)
dist_3 = Distance(PointA=shift, PointB=shift_2)
larger_4 = LargerThan(FirstNumber=dist_3, SecondNumber=number_slider_5)  # -> LargerThan, OrEqualTo
cull_2 = CullPattern(List=pt, CullPattern=larger_4.OrEqualTo)
gate_4 = StreamGate(Stream=cull_2, Gate=larger_3.LargerThan)  # -> Target0, Target1
merge = Merge(Data1=gate_4.Target0, Data2=gate_4.Target1)
Z_5 = UnitZ(Factor=item_2)
move_4 = Move(Geometry=merge, Motion=Z_5)  # -> Geometry, Transform
unflatten = UnflattenTree(Tree=move_4.Geometry, Guide=cull_2)
lng_4 = ListLength(List=unflatten)
merge_2 = Merge(Data1=cull_2, Data2=unflatten)
frompoints = MeshFromPoints(Points=merge_2, UDirection=2, VDirection=lng_4)

sort_surfaces_2 = SortSurfaces(B=brep_2, custom_order=0)  # -> lowest_2, highest_2, custom_2, remove_cap_2
data_8 = Data(gate_3.Target1)
debrep_2 = DeconstructBrep(Brep=simplify(sort_surfaces_2.highest_2))  # -> Faces, Edges, Vertices
join_2 = JoinCurves(Curves=debrep_2.Edges, Preserve=False)  # -> simplify(Curves)
lng_5 = ListLength(List=join_2)
larger_5 = LargerThan(FirstNumber=lng_5, SecondNumber=number_slider_4)  # -> LargerThan, flatten(OrEqualTo)
data_9 = Data(box_properties.zDim)
cull_3 = CullPattern(List=flatten(lng_5), CullPattern=larger_5.OrEqualTo)
mindex = MemberIndex(Set=larger_5.OrEqualTo, Member=Toggle(True))  # -> Index, Count
unflatten_2 = UnflattenTree(Tree=larger_5.OrEqualTo, Guide=data_9)  # -> flatten(Tree)
flatten = FlattenTree(Tree=data_9, Path="{0}")
flatten_2 = FlattenTree(Tree=cull_3, Path="{0}")
sift = SiftPattern(List=flatten, SiftPattern=unflatten_2)  # -> Output0, Output1
clean = CleanTree(RemoveNulls=True, RemoveInvalid=True, RemoveEmpty=True, Tree=sift.Output1)
subtraction = Subtraction(A=flatten_2, B=Slider(1, range=0..1))
dup = DuplicateData(Data=graft(clean), Number=graft(subtraction), Order=True)  # -> flatten(Data)
series = Series(Start=mindex.Index, Step=Slider(1, range=0..1), Count=subtraction)  # -> flatten(Series)
curvepoint_4 = PointOnCurve(data_8, parameter=0.5)
ins = InsertItems(List=flatten, Item=dup, Indices=series, Wrap=True)
pull = PullPoint(Point=curvepoint_4, Geometry=pl, ClosestOnly=True)  # -> ClosestPoint, Distance
unflatten_3 = UnflattenTree(Tree=ins, Guide=data_8)
sort_2 = SortList(Keys=pull.Distance, ValuesA=data_8, ValuesB=unflatten_3)  # -> Keys, ValuesA, ValuesB
curvepoint_5 = PointOnCurve(sort_2.ValuesA, parameter=0.5)
data_10 = Data(simplify(pgroups.Groups))
project_2 = Project(Geometry=curvepoint_5, Plane=PlaneXY(0, 0, 0))  # -> Geometry, Transform
item_3 = ListItem(List=data_10, Index=0, Wrap=True)
pgroups_2 = PointGroups(Points=project_2.Geometry, Distance=Slider(0.1, range=0..0.1))  # -> Groups, Indices
pshift_4 = ShiftPaths(Data=pgroups_2.Groups, Offset=-1)
pull_2 = PullPoint(Point=pshift_4, Geometry=item_3, ClosestOnly=True)  # -> ClosestPoint, Distance
sort_3 = SortList(Keys=pull_2.Distance, ValuesA=sort_2.ValuesA, ValuesB=sort_2.ValuesB)  # -> Keys, ValuesA, ValuesB
filter_2 = StreamFilter(Gate=0, Stream0=sort_2.ValuesA, Stream1=sort_3.ValuesA)
split = SplitTree(Data=filter_2, Masks=flatten("{*}[1,3,...]"))  # -> Positive, Negative
data_11 = Data(split.Negative)
data_12 = Data(split.Positive)
explode_3 = Explode(Curve=data_11, Recursive=True)  # -> Segments, Vertices
explode_4 = Explode(Curve=data_12, Recursive=True)  # -> Segments, Vertices
crv = Curve(explode_4.Segments)
crv_2 = Curve(explode_3.Segments)
len_2 = Length(Curve=crv_2)
len_3 = Length(Curve=crv)
division_4 = Division(A=len_2, B=panel_target_width)
division_5 = Division(A=len_3, B=panel_target_width)
int_2 = Integer(division_4)
int_3 = Integer(division_5)
range = Range(Domain=Domain(0, 1), Steps=int_2)
range_2 = Range(Domain=Domain(0, 1), Steps=int_3)
item_4 = ListItem(List=range, Index=0, Wrap=True)
item_5 = ListItem(List=range, Index=Slider(1, range=0..1), Wrap=True)
subtraction_2 = Subtraction(A=item_5, B=item_4)
division_6 = Division(A=subtraction_2, B=Slider(2, range=0..10))
addition = Addition(A=range, B=division_6)
lng_6 = ListLength(List=range)
cull_i = CullIndex(List=addition, Indices=expr("x-1", lng_6), Wrap=True)  # -> simplify(List)
tstat_3 = TreeStatistics(Tree=cull_i)  # -> Paths, Length, Count
repeat = RepeatData(Data=Slider(1, range=0..1), Length=tstat_3.Count)  # -> graft(Data)
repeat_2 = RepeatData(Data=Slider(0, range=0..100), Length=tstat_3.Count)  # -> graft(Data)
match_2 = MatchTree(Tree=repeat, Guide=cull_i)
match_3 = MatchTree(Tree=repeat_2, Guide=cull_i)
eval = EvaluateCurve(Curve=reparameterize(graft(crv)), Parameter=range_2)  # -> Point, Tangent, Angle
merge_3 = Merge(Data1=match_3, Data2=cull_i, Data3=match_2)
eval_2 = EvaluateCurve(Curve=reparameterize(graft(crv_2)), Parameter=merge_3)  # -> Point, Tangent, Angle
gate_5 = StreamGate(Stream=eval.Point, Gate=larger_2.LargerThan)  # -> Target0, Target1
gate_6 = StreamGate(Stream=eval_2.Point, Gate=larger_2.LargerThan)  # -> Target0, Target1
pshift_5 = ShiftPaths(Data=gate_5.Target1, Offset=-1)
pshift_6 = ShiftPaths(Data=gate_6.Target1, Offset=-1)
merge_4 = Merge(Data1=pshift_5, Data2=gate_5.Target0)
merge_5 = Merge(Data1=pshift_6, Data2=gate_6.Target0)
merge_6 = Merge(Data1=merge_4, Data2=merge_5)
data_13 = Data(merge_6)
shift_3 = ShiftList(List=data_13, Shift=1, Wrap=False)
shift_4 = ShiftList(List=data_13, Shift=-1, Wrap=False)
dist_4 = Distance(PointA=shift_3, PointB=shift_4)
larger_6 = LargerThan(FirstNumber=dist_4, SecondNumber=0.1)  # -> LargerThan, OrEqualTo
filter_3 = StreamFilter(Gate=0, Stream0=sort_2.ValuesB, Stream1=sort_3.ValuesB)
cull_4 = CullPattern(List=data_13, CullPattern=larger_6.OrEqualTo)
Z_6 = UnitZ(Factor=graft(filter_3))
move_5 = Move(Geometry=cull_4, Motion=Z_6)  # -> Geometry, Transform
flatten_3 = FlattenTree(Tree=move_5.Geometry, Path="{0}")
unflatten_4 = UnflattenTree(Tree=flatten_3, Guide=cull_4)
merge_7 = Merge(Data1=cull_4, Data2=unflatten_4)
lng_7 = ListLength(List=unflatten_4)  # -> simplify(Length)
frompoints_2 = MeshFromPoints(Points=merge_7, UDirection=2, VDirection=lng_7)

data_14 = Data(gate_3.Target2)
explode_5 = Explode(Curve=data_14, Recursive=True)  # -> Segments, Vertices
end = EndPoints(Curve=explode_5.Segments)  # -> Start, End
move_6 = Move(Geometry=pshift_2, Motion=Z_4)  # -> Geometry, Transform
explode_6 = Explode(Curve=move_6.Geometry, Recursive=True)  # -> simplify(Segments), Vertices
curvepoint_6 = PointOnCurve(explode_5.Segments, parameter=0.5)
curvepoint_7 = PointOnCurve(explode_6.Segments, parameter=0.507)
dist_5 = Distance(PointA=curvepoint_6, PointB=curvepoint_7)
item_6 = ListItem(List=dist_5, Index=0, Wrap=True)
Z_7 = UnitZ(Factor=item_6)

graft = GraftTree(Tree=data_14, IncludeEmptyLists=True, IncludeNullItems=True)

scx = SurfaceCurve(Surface=extr_2, Curve=graft)  # -> Curves, Points, UVPoints, Normals, Parameters, Tangents

pshift_7 = ShiftPaths(Data=scx.Points, Offset=-1)

gate_7 = StreamGate(Stream=pshift_7, Gate=python)  # -> Target0, Target1
flatten_4 = FlattenTree(Tree=gate_7.Target0, Path="{0}")
merge_8 = Merge(Data1=flatten_4, Data2=gate_7.Target1)
crv_cp = CurveClosestPoint(Point=merge_8, Curve=graft)  # -> Point, Parameter, Distance
merge_9 = Merge(Data1=crv_cp.Point, Data2=end.Start)
alongcrv = SortAlongCurve(Points=merge_9, Curve=graft)  # -> simplify(Points), Indices
crv_cp_2 = CurveClosestPoint(Point=alongcrv.Points, Curve=graft)  # -> Point, simplify(Parameter), Distance
shatter = Shatter(Curve=graft, Parameters=crv_cp_2.Parameter)
end_2 = EndPoints(Curve=shatter)  # -> Start, End
pshift_8 = ShiftPaths(Data=end_2.Start, Offset=-1)
item_7 = ListItem(List=pshift_8, Index=0, Wrap=True)
lng_8 = ListLength(List=pshift_8)
ins_2 = InsertItems(List=pshift_8, Item=item_7, Indices=lng_8, Wrap=True)
move_7 = Move(Geometry=ins_2, Motion=Z_7)  # -> Geometry, Transform
merge_10 = Merge(Data1=ins_2, Data2=move_7.Geometry)
lng_9 = ListLength(List=simplify(move_7.Geometry))
frompoints_3 = MeshFromPoints(Points=merge_10, UDirection=2, VDirection=lng_9)

# ----
# Remap Paths Properly
merge_11 = Merge(Data1=frompoints, Data2=frompoints_2, Data3=frompoints_3)
data_15 = Data(merge_11)
tstat_4 = TreeStatistics(Tree=data_15)  # -> Paths, Length, Count
item_8 = ListItem(List=tstat_4.Paths, Index=0, Wrap=True)
chars = Characters(Text=item_8)  # -> Result, Unicode
cset = CreateSet(List=chars.Result)  # -> Set, Map
item_9 = ListItem(List=cset.Set, Index=Slider(1, range=0..1), Wrap=True)
mindex_2 = MemberIndex(Set=chars.Result, Member=item_9)  # -> Index, Count
python_2 = GhPythonScript(x=mindex_2.Count)  # -> a
# ---------- python_2: Python ----------
__author__ = "MTS"
__version__ = "2021.03.23"

import rhinoscriptsyntax as rs
if (x==6):
    a=0
if (x==5):
    a=1
if (x==4):
    a=2
if (x==3):
    a=3
if (x==2):
    a=4
# ---------- end python_2 ----------
gate_8 = StreamGate(Stream=data_15, Gate=python_2)  # -> Target0, Target1, Target2, Target3, Target4
path_mapper = PathMapper(gate_8.Target2, source="{A;B;C;D}", target="{B;C}")
path_mapper_2 = PathMapper(gate_8.Target4, source="{A;B}", target="{A;B}")
path_mapper_3 = PathMapper(gate_8.Target1, source="{A;B;C;D;E}", target="{A;C}")
path_mapper_4 = PathMapper(gate_8.Target0, source="{A;B;C;D;E;F}", target="{A;B}")
path_mapper_5 = PathMapper(gate_8.Target3, source="{A;B;C}", target="{A;B}")
merge_12 = Merge(Data1=path_mapper_4, Data2=path_mapper_3, Data3=path_mapper, Data4=path_mapper_5, Data5=path_mapper_2)
explode_7 = MeshExplode(Mesh=merge_12, Interpolate=False)

# ----
# Main Mesh
pshift_9 = ShiftPaths(Data=explode_7, Offset=-1)

# ----
# Orient Planes
data_16 = Data(pshift_9)
demesh = DeconstructMesh(Mesh=data_16)  # -> Vertices, Faces, Colours, Normals
area_2 = Area(Geometry=data_16)  # -> Area, Centroid
item_10 = ListItem(List=demesh.Normals, Index=0, Wrap=True)
neg_4 = Negative(Value=item_10)
pshift_10 = ShiftPaths(Data=neg_4, Offset=-1)
line = LineSDL(Start=area_2.Centroid, Direction=pshift_10, Length=1)
frame = CurveFrame(Curve=reparameterize(line), Parameter=Slider(0, range=0..1))
deplane = DeconstructPlane(Plane=frame)  # -> Origin, XAxis, YAxis, ZAxis
pt_2 = ConstructPoint(XCoordinate=0, YCoordinate=0, ZCoordinate=0)
Z_8 = UnitZ(Factor=1)
rot3d = Rotate3D(Geometry=frame, Angle=1.570796327, Center=frame, Axis=deplane.YAxis)  # -> Geometry, Transform
line_2 = LineSDL(Start=pt_2, Direction=Vector(0, 0, 1), Length=Z_8)
deplane_2 = DeconstructPlane(Plane=rot3d.Geometry)  # -> Origin, XAxis, YAxis, ZAxis
angle = Angle(VectorA=line_2, VectorB=deplane_2.YAxis)  # -> Angle, Reflex
deg = Degrees(Radians=angle.Angle)
equals = Equality(FirstNumber=deg, SecondNumber=Slider(0, range=0..100))  # -> Equality, Inequality
sift_2 = SiftPattern(List=deg, SiftPattern=equals.Equality)  # -> Output0, Output1
sift_3 = SiftPattern(List=rot3d.Geometry, SiftPattern=equals.Equality)  # -> Output0, Output1
neg_5 = Negative(Value=sift_2.Output0)
prot = RotatePlane(Plane=sift_3.Output0, Angle=degrees(neg_5))
data_17 = Data(sift_3.Output1)
combine = CombineData(Input0=prot, Input1=data_17)  # -> Result, Index
vec = VectorXYZ(XComponent=0, YComponent=0, ZComponent=0)  # -> Vector, Length
line_3 = LineSDL(Start=vec.Vector, Direction=Vector(0, 0, 1), Length=1)
align = AlignPlane(Plane=combine.Result, Direction=line_3)  # -> Plane, Angle
neg_6 = Negative(Value=Slider(90, range=0..1000))
prot_2 = RotatePlane(Plane=align.Plane, Angle=degrees(neg_6))
deplane_3 = DeconstructPlane(Plane=prot_2)  # -> Origin, XAxis, YAxis, ZAxis
line_4 = LineSDL(Start=deplane_3.Origin, Direction=deplane_3.ZAxis, Length=Slider(2.15, range=0..100))

# ----
# Random
panel_2 = Panel("Block")
gate_9 = StreamGate(Stream=simplify(prot_2), Gate=list_6)  # -> Target0, Target1, Target2, Target3, Target4, Target5, Target6, Target7
dpipeline = DynamicGeometryPipeline(
    LayerFilter="Facade_Blocks",
    TypeFilter=panel_2,
    NameFilter="*",
    GroupByLayer=False,
    GroupByType=False,
    IncludeHidden=True,
    IncludeLocked=True,
    enableFullPath=False,
    listenToAttributes=True)
tsort = SortText(Keys=dpipeline, Culture=127)  # -> Keys, Values
cset_2 = CreateSet(List=tsort.Keys)  # -> Set, Map
split_2 = TextSplit(Text=cset_2.Set, Separators=":")
item_11 = ListItem(List=split_2, Index=Slider(1, range=0..1), Wrap=True)
chars_2 = Characters(Text=item_11)  # -> Result, Unicode
item_12 = ListItem(List=chars_2.Result, Index=Slider(1, range=0..1), Wrap=True)  # -> flatten(Item)
tsort_2 = SortText(Keys=item_12, Culture=127)  # -> Keys, Values
pull_3 = PullPoint(Point=flatten(gate_9.Target6), Geometry=pipeline_3, ClosestOnly=True)  # -> ClosestPoint, Distance
bnd = Bounds(Numbers=pull_3.Distance)
data_18 = Data(tsort_2.Keys)
remap = RemapNumbers(Value=pull_3.Distance, Source=bnd, Target=Domain(0, 1))  # -> Mapped, Clipped
graph = GraphMapper(
    remap.Mapped,
    x0=0,
    x1=1,
    y0=0,
    y1=1,
    container_name="Bezier",
    cpx=[0, 0.5121212006, 0.3696969748, 1],
    cpy=[0, 0.2862903476, 0.8991935253, 1])
lng_10 = ListLength(List=graph)
bnd_2 = Bounds(Numbers=graph)
lng_11 = ListLength(List=data_18)
random = Random(Range=Domain(0, 1), Number=lng_10, Seed=2)
div = DivideDomain(Domain=bnd_2, Count=lng_11)
cset_3 = CreateSet(List=data_18)  # -> simplify(Set), Map
twn2nums = TweenTwoNumbers(NumberA=graft(graph), NumberB=graft(random), Factor=Slider(1, range=0..1))  # -> flatten(Tween)
fdom = FindDomain(Domains=div, Number=twn2nums, Strict=False)  # -> Index, Neighbour
cset_4 = CreateSet(List=fdom.Index)  # -> flatten(Set), Map
sort_4 = SortList(Keys=cset_4.Set)  # -> Keys, ValuesA
cset_5 = CreateSet(List=sort_4.Keys)  # -> simplify(flatten(Set)), Map
round = Round(Number=cset_5.Set)  # -> Nearest, Floor, Ceiling
replace_4 = ReplaceMembers(Set=fdom.Index, Find=round.Nearest, Replace=cset_3.Set)
graft_2 = GraftTree(Tree=simplify(replace_4), IncludeEmptyLists=True, IncludeNullItems=True)  # -> simplify(Tree)
unflatten_5 = UnflattenTree(Tree=graft_2, Guide=pshift_9)

# ---- group: Get Mesh Dimensions
data_19 = Data(pshift_9)
explode_8 = MeshExplode(Mesh=data_19, Interpolate=False)
wbedges = WeaverbirdsMeshEdges(MeshOrPolylines=explode_8)
curvepoint_8 = PointOnCurve(wbedges, parameter=0.5)
pdecon_2 = Deconstruct(Point=curvepoint_8)  # -> XComponent, YComponent, ZComponent
sort_5 = SortList(Keys=pdecon_2.ZComponent, ValuesA=wbedges)  # -> Keys, ValuesA
item_13 = ListItem(List=sort_5.ValuesA, Index=0, Wrap=True)
item_14 = ListItem(List=sort_5.ValuesA, Index=Slider(1, range=0..1), Wrap=True)
len_4 = Length(Curve=item_13)
len_5 = Length(Curve=item_14)
pshift_11 = ShiftPaths(Data=len_5, Offset=-1)
pshift_12 = ShiftPaths(Data=len_4, Offset=-1)
round_2_decimal = Round2Decimal(L=pshift_11)
round_2_decimal_2 = Round2Decimal(L=pshift_12)

# ----
# Attractor
panel_3 = Panel("Block")
gate_10 = StreamGate(Stream=panel_3, Gate=0)  # -> Target0, Target1
merge_13 = Merge(Data1=gate_10.Target0, Data2=gate_10.Target1)
dpipeline_2 = DynamicGeometryPipeline(
    LayerFilter="Facade_Blocks",
    TypeFilter=merge_13,
    NameFilter="*",
    GroupByLayer=False,
    GroupByType=False,
    IncludeHidden=True,
    IncludeLocked=True,
    enableFullPath=False,
    listenToAttributes=True)
tsort_3 = SortText(Keys=dpipeline_2, Culture=127)  # -> Keys, Values
cset_6 = CreateSet(List=tsort_3.Keys)  # -> Set, Map
split_3 = TextSplit(Text=cset_6.Set, Separators=":")
item_15 = ListItem(List=split_3, Index=Slider(1, range=0..1), Wrap=True)
chars_3 = Characters(Text=item_15)  # -> Result, Unicode
item_16 = ListItem(List=chars_3.Result, Index=Slider(1, range=0..1), Wrap=True)  # -> flatten(Item)
number_slider_7 = Slider(1, range=0..1)
number_slider_8 = Slider(0, range=0..100)
tsort_4 = SortText(Keys=item_16, Culture=127)  # -> Keys, Values
dom = ConstructDomain(DomainStart=number_slider_7, DomainEnd=number_slider_8)
dom_2 = ConstructDomain(DomainStart=number_slider_8, DomainEnd=number_slider_7)
filter_4 = StreamFilter(Gate=list_9, Stream0=dom_2, Stream1=dom)
data_20 = Data(tsort_4.Keys)
lng_12 = ListLength(List=data_20)
cset_7 = CreateSet(List=data_20)  # -> simplify(Set), Map

# ----
# Configurations
merge_14 = Merge(Data1=list_4, Data2=list_5, Data3=list_2, Data4=list_3)
gate_11 = StreamGate(Stream=simplify(prot_2), Gate=list_6)  # -> Target0, Target1, Target2, Target3, Target4, Target5, Target6, Target7
item_17 = ListItem(List=merge_14, Index=0, Wrap=True)  # -> Item, Item1

# ----
# Checkerboard
gate_12 = StreamGate(Stream=simplify(pshift_9), Gate=list_6)  # -> Target0, Target1, Target2, Target3, Target4, Target5, Target6, Target7
lng_13 = ListLength(List=simplify(pshift_9))
split_4 = SplitTree(Data=gate_12.Target2, Masks=flatten("{*;0,2,....}"))  # -> Positive, Negative
repeat_3 = RepeatData(Data=Slider(0, range=0..100), Length=lng_13)  # -> simplify(Data)
viewer_2 = ParamViewer(split_4.Negative)
viewer_3 = ParamViewer(split_4.Positive)
branch = TreeBranch(Tree=simplify(repeat_3), Path=viewer_2, MaintainPaths=True)
merge_15 = Merge(Data1=Toggle(False), Data2=Toggle(True))
branch_2 = TreeBranch(Tree=simplify(repeat_3), Path=viewer_3, MaintainPaths=True)
merge_16 = Merge(Data1=Toggle(True), Data2=Toggle(False))
sift_4 = SiftPattern(List=branch, SiftPattern=merge_15)  # -> Output0, Output1
sift_5 = SiftPattern(List=branch_2, SiftPattern=merge_16)  # -> Output0, Output1
data_21 = Data(flatten(sift_4.Output1))
data_22 = Data(flatten(sift_5.Output1))
cset_8 = CreateSet(List=flatten(data_21))  # -> Set, Map
cset_9 = CreateSet(List=flatten(data_22))  # -> Set, Map
number_slider_9 = Slider(1, range=0..1)
mindex_3 = MemberIndex(Set=data_21, Member=cset_8.Set)  # -> Index, Count
mindex_4 = MemberIndex(Set=data_22, Member=cset_9.Set)  # -> Index, Count
replace_5 = ReplaceItems(List=data_21, Item=number_slider_9, Indices=mindex_3.Index, Wrap=False)
replace_6 = ReplaceItems(List=data_22, Item=number_slider_9, Indices=mindex_4.Index, Wrap=False)
unflatten_6 = UnflattenTree(Tree=replace_5, Guide=sift_4.Output1)
unflatten_7 = UnflattenTree(Tree=replace_6, Guide=sift_5.Output1)
combine_2 = CombineData(Input0=sift_4.Output0, Input1=unflatten_6)  # -> Result, Index
combine_3 = CombineData(Input0=sift_5.Output0, Input1=unflatten_7)  # -> Result, Index
merge_17 = Merge(Data1=combine_3.Result, Data2=combine_2.Result)
clean_2 = CleanTree(RemoveNulls=True, RemoveInvalid=True, RemoveEmpty=False, Tree=merge_17)
merge_18 = Merge(Data1=item_17.Item, Data2=item_17.Item1)
merge_19 = Merge(Data1=Slider(0, range=0..100), Data2=Slider(1, range=0..100))
replace_7 = ReplaceMembers(Set=clean_2, Find=merge_19, Replace=merge_18)

pull_4 = PullPoint(Point=flatten(gate_11.Target5), Geometry=pipeline_3, ClosestOnly=True)  # -> ClosestPoint, Distance
bnd_3 = Bounds(Numbers=pull_4.Distance)
remap_2 = RemapNumbers(Value=pull_4.Distance, Source=bnd_3, Target=filter_4)  # -> Mapped, Clipped
graph_2 = GraphMapper(
    remap_2.Mapped,
    x0=0,
    x1=1,
    y0=0,
    y1=1,
    container_name="Bezier",
    cpx=[0, 0.5121212006, 0.3696969748, 1],
    cpy=[0, 0.2862903476, 0.8991935253, 1])
lng_14 = ListLength(List=graph_2)
bnd_4 = Bounds(Numbers=graph_2)
random_2 = Random(Range=Domain(0, 1), Number=lng_14, Seed=2)
div_2 = DivideDomain(Domain=bnd_4, Count=lng_12)
twn2nums_2 = TweenTwoNumbers(NumberA=graft(graph_2), NumberB=graft(random_2), Factor=Slider(0.3, range=0..1))  # -> flatten(Tween)
fdom_2 = FindDomain(Domains=div_2, Number=twn2nums_2, Strict=False)  # -> Index, Neighbour
cset_10 = CreateSet(List=fdom_2.Index)  # -> flatten(Set), Map
sort_6 = SortList(Keys=cset_10.Set)  # -> Keys, ValuesA
cset_11 = CreateSet(List=sort_6.Keys)  # -> simplify(flatten(Set)), Map
round_2 = Round(Number=cset_11.Set)  # -> Nearest, Floor, Ceiling
replace_8 = ReplaceMembers(Set=fdom_2.Index, Find=round_2.Nearest, Replace=cset_7.Set)
graft_3 = GraftTree(Tree=simplify(replace_8), IncludeEmptyLists=True, IncludeNullItems=True)  # -> simplify(Tree)
unflatten_8 = UnflattenTree(Tree=graft_3, Guide=pshift_9)

# ----
# Ends
gate_13 = StreamGate(Stream=pshift_9, Gate=list_6)  # -> Target0, Target1, Target2, Target3, Target4, Target5, Target6, Target7
data_23 = Data(gate_13.Target1)
unflatten_9 = UnflattenTree(Tree=data_23)
split_5 = SplitTree(Data=unflatten_9, Masks=flatten("{*;*;0,2,...}"))  # -> Positive, Negative
data_24 = Data(split_5.Positive)
data_25 = Data(split_5.Negative)
lng_15 = ListLength(List=data_24)
lng_16 = ListLength(List=data_25)
subtraction_3 = Subtraction(A=lng_15, B=Slider(1, range=0..1))
subtraction_4 = Subtraction(A=lng_16, B=Slider(1, range=0..1))
range_3 = Range(Domain=subtraction_3, Steps=subtraction_3)
range_4 = Range(Domain=subtraction_4, Steps=subtraction_4)
replace_9 = ReplaceItems(List=data_25, Item=item_17.Item1, Indices=range_4, Wrap=False)
replace_10 = ReplaceItems(List=data_24, Item=item_17.Item, Indices=range_3, Wrap=False)
merge_20 = Merge(Data1=replace_10, Data2=replace_9)
unflatten_10 = UnflattenTree(Tree=merge_20, Guide=data_23)

# ----
# Simple
gate_14 = StreamGate(Stream=pshift_9, Gate=list_6)  # -> Target0, Target1, Target2, Target3, Target4, Target5, Target6, Target7
lng_17 = ListLength(List=gate_14.Target0)
repeat_4 = RepeatData(Data=item_17.Item, Length=lng_17)
data_26 = Data(repeat_4)

# ----
# Oreientation
gate_15 = StreamGate(Stream=simplify(prot_2), Gate=list_6)  # -> Target0, Target1, Target2, Target3, Target4, Target5, Target6, Target7
data_27 = Data(line_4)
end_3 = EndPoints(Curve=data_27)  # -> Start, End
line_5 = Line(Line((84.7577947, 3.786713809, 0), (84.7577947, 33.36664756, 0)))
angle_2 = Angle(VectorA=data_27, VectorB=line_5, Plane=end_3.Start)  # -> Angle, Reflex
panel_4 = Panel("""0
90
270
180""")
deg_2 = Degrees(Radians=angle_2.Angle)  # -> flatten(Degrees)
num = Number(panel_4)
num_2 = Number(deg_2)
merge_21 = Merge(Data1=merge_14, Data2=merge_14, Data3=merge_14, Data4=merge_14)
panel_5 = Panel(merge_21)

# ---- group: Find nearest Value
python_3 = GhPythonScript(lst=num, y=num_2)  # -> flatten(out), a; inputs lst: list
# ---------- python_3: Python ----------
__author__ = "MTS"
__version__ = "2021.06.09"

import rhinoscriptsyntax as rs




def closest(lst, K):
      
    return lst[min(range(len(lst)), key = lambda i: abs(lst[i]-K))]
      
# Driver code
#lst = [3.64, 5.2, 9.42, 9.35, 8.5, 8]


K = y

print(closest(lst, K))
# ---------- end python_3 ----------

# ----
int_4 = Integer(python_3.out)
cset_12 = CreateSet(List=int_4)  # -> Set, Map
bnd_5 = Bounds(Numbers=cset_12.Set)
div_3 = DivideDomain(Domain=bnd_5, Count=Slider(4, range=0..10))
fdom_3 = FindDomain(Domains=div_3, Number=int_4, Strict=False)  # -> Index, Neighbour
cset_13 = CreateSet(List=fdom_3.Index)  # -> Set, Map
sort_7 = SortList(Keys=cset_13.Set)  # -> Keys, ValuesA
panel_6 = Panel(fdom_3.Index)
panel_7 = Panel(sort_7.Keys)
lng_18 = ListLength(List=panel_7)
repeat_5 = RepeatData(Data=panel_5, Length=lng_18)
replace_11 = ReplaceMembers(Set=panel_6, Find=panel_7, Replace=repeat_5)
unflatten_11 = UnflattenTree(Tree=replace_11, Guide=gate_15.Target7)

# ----
# Alternating Horizontal
gate_16 = StreamGate(Stream=simplify(pshift_9), Gate=list_6)  # -> Target0, Target1, Target2, Target3, Target4, Target5, Target6, Target7
split_6 = SplitTree(Data=gate_16.Target4, Masks=flatten("{*;0,2,...}"))  # -> Positive, Negative
data_28 = Data(split_6.Positive)
data_29 = Data(split_6.Negative)
lng_19 = ListLength(List=data_28)
lng_20 = ListLength(List=data_29)
repeat_6 = RepeatData(Data="0", Length=lng_19)  # -> simplify(Data)
repeat_7 = RepeatData(Data="1", Length=lng_20)  # -> simplify(Data)
match_4 = MatchTree(Tree=repeat_6, Guide=data_28)
match_5 = MatchTree(Tree=repeat_7, Guide=data_29)
merge_22 = Merge(Data1=match_4, Data2=match_5)
merge_23 = Merge(Data1=Slider(0, range=0..100), Data2=Slider(1, range=0..1))
clean_3 = CleanTree(RemoveNulls=True, RemoveInvalid=True, RemoveEmpty=False, Tree=merge_22)
panel_8 = Panel(merge_23)
merge_24 = Merge(Data1=item_17.Item, Data2=item_17.Item1)

# ----
# Alternating Vertical
gate_17 = StreamGate(Stream=simplify(pshift_9), Gate=list_6)  # -> Target0, Target1, Target2, Target3, Target4, Target5, Target6, Target7
data_30 = Data(gate_17.Target3)
panel_9 = Panel("""0
1""")
sift_6 = SiftPattern(List=data_30, SiftPattern=panel_9)  # -> Output0, Output1
nullrep = ReplaceNulls(Items=sift_6.Output0, Replacements=Slider(0, range=0..100))  # -> Items, Count
nullrep_2 = ReplaceNulls(Items=sift_6.Output1, Replacements=Slider(1, range=0..1))  # -> Items, Count
sift_7 = SiftPattern(List=nullrep.Items, SiftPattern=panel_9)  # -> Output0, Output1
sift_8 = SiftPattern(List=nullrep_2.Items, SiftPattern=panel_9)  # -> Output0, Output1
combine_4 = CombineData(Input0=sift_7.Output1, Input1=sift_8.Output0)  # -> Result, Index
merge_25 = Merge(Data1=Slider(0, range=0..100), Data2=Slider(1, range=0..1))
merge_26 = Merge(Data1=item_17.Item, Data2=item_17.Item1)
clean_4 = CleanTree(RemoveNulls=True, RemoveInvalid=True, RemoveEmpty=False, Tree=combine_4.Result)
panel_10 = Panel(merge_25)

panel_11 = Panel(clean_3)
panel_12 = Panel(merge_26)
panel_13 = Panel(clean_4)

replace_12 = ReplaceMembers(Set=panel_11, Find=panel_8, Replace=merge_24)

replace_13 = ReplaceMembers(Set=panel_13, Find=panel_10, Replace=panel_12)

filter_5 = StreamFilter(
    Gate=list_6,
    Stream0=data_26,
    Stream1=unflatten_10,
    Stream2=replace_7,
    Stream3=replace_13,
    Stream4=replace_12,
    Stream5=unflatten_8,
    Stream6=unflatten_5,
    Stream7=unflatten_11)
data_31 = Data(simplify(filter_5))

# ---- group: Get Blocks
trigger = Trigger(Interval=-1000, TimerInterval=1000, Target=dpipeline_3)
cset_14 = CreateSet(List=flatten(filter_5))  # -> Set, Map
dpipeline_3 = DynamicGeometryPipeline(
    LayerFilter="Facade_Blocks",
    TypeFilter="Block",
    NameFilter="*",
    GroupByLayer=False,
    GroupByType=False,
    IncludeHidden=True,
    IncludeLocked=True,
    enableFullPath=False,
    listenToAttributes=True)
concat = Concatenate(FragmentA="*", FragmentB=cset_14.Set, FragmentC="*")  # -> flatten(Result)
blockexplode = ExplodeBlocks(BlockObjects=dpipeline_3, explodeGeom=True)  # -> Geometry, Attributes, flatten(BlockName), flatten(BoundingBox), BlockTransform, flatten(InsertionPlane), flatten(InstanceCount)
tsort_5 = SortText(Keys=concat, Culture=127)  # -> Keys, Values
chars_4 = Characters(Text=blockexplode.BlockName)  # -> Result, Unicode
item_18 = ListItem(List=tsort_5.Keys, Index=0, Wrap=True)
item_19 = ListItem(List=chars_4.Result, Index=0, Wrap=True)  # -> flatten(Item)
tmatch = MatchText(Text=item_19, Pattern=graft(item_18), Case=True)
tmatch_2 = MatchText(Text=item_19, Pattern=graft(tsort_5.Keys), Case=True)
flip = FlipMatrix(Data=tmatch)
flip_2 = FlipMatrix(Data=tmatch_2)
tsort_6 = SortText(Keys=flip, Culture=127)  # -> Keys, Values
tsort_7 = SortText(Keys=flip_2, Culture=127)  # -> Keys, Values
item_20 = ListItem(List=tsort_6.Keys, Index=Slider(1, range=0..1), Wrap=True)  # -> flatten(Item)
item_21 = ListItem(List=tsort_7.Keys, Index=Slider(-1, range=-1..0), Wrap=True)  # -> flatten(Item)
cull_5 = CullPattern(List=blockexplode.BlockName, CullPattern=item_20)
cull_6 = CullPattern(List=blockexplode.BoundingBox, CullPattern=item_20)
cull_7 = CullPattern(List=blockexplode.BlockName, CullPattern=item_21)
data_32 = Data(cull_5)
data_33 = Data(cull_6)
debox = DeconstructBox(Box=data_33)  # -> Plane, X, Y, Z
dedomain = DeconstructDomain(Domain=debox.X)  # -> Start, End
dedomain_2 = DeconstructDomain(Domain=debox.Y)  # -> Start, End
abs = Absolute(Value=dedomain.Start)
abs_2 = Absolute(Value=dedomain_2.Start)
addition_2 = Addition(A=abs, B=dedomain.End)
addition_3 = Addition(A=abs_2, B=dedomain_2.End)
round_2_decimal_3 = Round2Decimal(L=addition_2)  # -> flatten(R)
round_2_decimal_4 = Round2Decimal(L=addition_3)  # -> flatten(R)

# ----
viewer_4 = ParamViewer(data_31)

# ---- group: Match Mesh with Blocks
subtraction_5 = Subtraction(A=graft(round_2_decimal_4), B=round_2_decimal)
subtraction_6 = Subtraction(A=graft(round_2_decimal_3), B=round_2_decimal_2)
flip_3 = FlipMatrix(Data=subtraction_5)
flip_4 = FlipMatrix(Data=subtraction_6)
abs_3 = Absolute(Value=flip_3)
abs_4 = Absolute(Value=flip_4)
graft_4 = GraftTree(Tree=abs_4, IncludeEmptyLists=True, IncludeNullItems=True)
graft_5 = GraftTree(Tree=abs_3, IncludeEmptyLists=True, IncludeNullItems=True)
merge_27 = Merge(Data1=graft_4, Data2=graft_5)
ma = MassAddition(Input=merge_27)  # -> Result, PartialResults
pshift_13 = ShiftPaths(Data=ma.Result, Offset=-1)
sort_8 = SortList(Keys=pshift_13, ValuesA=data_32, ValuesB=data_33)  # -> Keys, ValuesA, ValuesB

# ---- group: Get Transformation Data
item_22 = ListItem(List=sort_8.ValuesB, Index=0, Wrap=True)  # -> flatten(Item)
unflatten_12 = UnflattenTree(Tree=item_22, Guide=pshift_9)
debox_2 = DeconstructBox(Box=unflatten_12)  # -> Plane, X, Y, Z
dedomain_3 = DeconstructDomain(Domain=debox_2.X)  # -> Start, End
dedomain_4 = DeconstructDomain(Domain=debox_2.Y)  # -> Start, End
abs_5 = Absolute(Value=dedomain_3.Start)
abs_6 = Absolute(Value=dedomain_3.End)
abs_7 = Absolute(Value=dedomain_4.Start)
abs_8 = Absolute(Value=dedomain_4.End)
merge_28 = Merge(Data1=graft(abs_5), Data2=graft(abs_6))
merge_29 = Merge(Data1=graft(abs_7), Data2=graft(abs_8))
ma_2 = MassAddition(Input=merge_28)  # -> flatten(Result), PartialResults
ma_3 = MassAddition(Input=merge_29)  # -> flatten(Result), PartialResults
data_34 = Data(flatten(len_5))
data_35 = Data(flatten(len_4))
pt_3 = ConstructPoint(XCoordinate=0, YCoordinate=0, ZCoordinate=0)
data_36 = Data(prot_2)
division_7 = Division(A=data_35, B=ma_2.Result)
division_8 = Division(A=data_34, B=ma_3.Result)
orient = Orient(Geometry=unflatten_12, Source=pt_3, Target=data_36)  # -> Geometry, Transform
unflatten_13 = UnflattenTree(Tree=division_8, Guide=pshift_9)
unflatten_14 = UnflattenTree(Tree=division_7, Guide=pshift_9)
filter_6 = StreamFilter(Gate=Toggle(True), Stream0=Slider(1, range=0..1), Stream1=unflatten_14)
filter_7 = StreamFilter(Gate=toggle_2, Stream0=Slider(1, range=0..1), Stream1=unflatten_13)
scale_nu = ScaleNU(Geometry=orient.Geometry, Plane=prot_2, ScaleX=filter_6, ScaleY=filter_7, ScaleZ=1)  # -> Geometry, Transform
flatten_5 = FlattenTree(Tree=orient.Transform, Path="{0}")
flatten_6 = FlattenTree(Tree=scale_nu.Transform, Path="{0}")
merge_30 = Merge(Data1=graft(flatten_5), Data2=graft(flatten_6))
comp = Compound(Transforms=merge_30)
unflatten_15 = UnflattenTree(Tree=comp, Guide=scale_nu.Transform)

# ----
# Assign_Blocks
data_37 = Data(cull_7)
tsort_8 = SortText(Keys=data_37, Culture=127)  # -> Keys, Values

# ---- group: Get Correspoding configuration Name
item_23 = ListItem(List=sort_8.ValuesA, Index=0, Wrap=True)  # -> flatten(Item)
unflatten_16 = UnflattenTree(Tree=item_23, Guide=pshift_9)
data_38 = Data(simplify(data_31))
chars_5 = Characters(Text=unflatten_16)  # -> Result, Unicode
cull_i_2 = CullIndex(List=chars_5.Result, Indices=Slider(0, range=0..100), Wrap=True)
graft_6 = GraftTree(Tree=data_38, IncludeEmptyLists=True, IncludeNullItems=True)
pshift_14 = ShiftPaths(Data=cull_i_2, Offset=-1)  # -> simplify(Data)
merge_31 = Merge(Data1=graft_6, Data2=pshift_14)
join_3 = TextJoin(Text=merge_31)
unflatten_17 = UnflattenTree(Tree=join_3, Guide=pshift_9)  # -> flatten(Tree)
flatten_7 = FlattenTree(Tree=unflatten_16, Path="{0}")
c_script = CSharpScript(data=graft(unflatten_17), keys=tsort_8.Keys)  # -> out, flatten(Match); inputs data: list of String, keys: list of String
# ---------- c_script: C# ----------
    bool match = false;
    for (int i = 0; i < keys.Count; i++)
    {
      if (data[0] == keys[i])
      {
        match = true;
        break;
      }

    }
    Match = match;
# ---------- end c_script ----------
sift_9 = SiftPattern(List=flatten_7, SiftPattern=c_script.Match)  # -> Output0, Output1
sift_10 = SiftPattern(List=unflatten_17, SiftPattern=c_script.Match)  # -> Output0, Output1
combine_5 = CombineData(Input0=sift_9.Output0, Input1=sift_10.Output1)  # -> Result, Index
unflatten_18 = UnflattenTree(Tree=combine_5.Result, Guide=pshift_9)
cset_15 = CreateSet(List=flatten(unflatten_18))  # -> Set, Map
tsort_9 = SortText(Keys=cset_15.Set, Culture=127)  # -> Keys, Values

# ----
# Blocks In Use
blocks_in_use = Panel(tsort_9.Keys)

# ---- group: Bake
createatts = CreateAttributes(GroupIndices=Toggle(True), enableFullPath=False)
placeblock = PlaceBlock(BlockName=unflatten_18, Transform=unflatten_15, Bake=button, Attributes=createatts)

# ----
# Colourize Mesh Types
data_39 = Data(flatten(data_31))
cset_16 = CreateSet(List=data_39)  # -> Set, Map
lng_21 = ListLength(List=cset_16.Set)
lng_22 = ListLength(List=cset_16.Set)
series_2 = Series(Start=Slider(0, range=0..100), Step=Slider(1, range=0..1), Count=lng_21)
data_40 = Data(lng_22)
data_41 = Data(data_39)
dom_3 = ConstructDomain(DomainStart=Slider(0, range=0..150), DomainEnd=Slider(255, range=0..1000))
replace_14 = ReplaceMembers(Set=data_41, Find=cset_16.Set, Replace=series_2)
div_4 = DivideDomain(Domain=dom_3, Count=data_40)
dedomain_5 = DeconstructDomain(Domain=div_4)  # -> Start, End
number_slider_10 = Slider(255, range=0..1000)
bnd_6 = Bounds(Numbers=replace_14)
data_42 = Data(list_6)
div_5 = DivideDomain(Domain=bnd_6, Count=data_40)
equals_2 = Equality(FirstNumber=data_42, SecondNumber=Slider(7, range=0..10))  # -> Equality, Inequality
rgb = ColourRGB(Alpha=255, Red=number_slider_10, Green=number_slider_10, Blue=0)
rgb_2 = ColourRGB(Alpha=255, Red=Slider(255, range=0..1000), Green=0, Blue=0)
rgb_3 = ColourRGB(Alpha=255, Red=0, Green=Slider(255, range=0..1000), Blue=0)
rgb_4 = ColourRGB(Alpha=255, Red=0, Green=0, Blue=Slider(255, range=0..1000))
rgb_5 = ColourRGB(Alpha=255, Red=dedomain_5.End, Green=0, Blue=dedomain_5.End)
range_5 = Range(Domain=data_40, Steps=data_40)
merge_32 = Merge(Data1=rgb, Data2=rgb_2, Data3=rgb_3, Data4=rgb_4)
fdom_4 = FindDomain(Domains=div_5, Number=replace_14, Strict=False)  # -> Index, Neighbour
filter_8 = StreamFilter(Gate=equals_2.Equality, Stream0=rgb_5, Stream1=merge_32)
cull_i_3 = CullIndex(List=range_5, Indices=Slider(-1, range=-1..0), Wrap=True)
num_3 = Number(fdom_4.Index)
data_43 = Data(data_31)
gate_18 = StreamGate(Stream=data_43, Gate=replace)  # -> Target0, flatten(Target1)
gate_19 = StreamGate(Stream=prot_2, Gate=replace)  # -> Target0, flatten(Target1)
cset_17 = CreateSet(List=flatten(gate_18.Target1))  # -> Set, Map
replace_15 = ReplaceMembers(Set=num_3, Find=cull_i_3, Replace=filter_8)
panel_14 = Panel("""North
East
South
West""")
tsort_10 = SortText(Keys=cset_17.Set, Culture=127)  # -> Keys, Values
panel_15 = Panel(tsort_10.Keys)
mcol = MeshColours(Mesh=simplify(graft(pshift_9)), Colours=simplify(graft(replace_15)))
lng_23 = ListLength(List=panel_15)
repeat_8 = RepeatData(Data=panel_14, Length=lng_23)
replace_16 = ReplaceMembers(Set=gate_18.Target1, Find=tsort_10.Keys, Replace=repeat_8)
concat_2 = Concatenate(FragmentA=gate_18.Target1, FragmentB=replace_16)
gate_20 = StreamGate(Stream=mcol, Gate=replace)  # -> Target0, flatten(Target1)
filter_9 = StreamFilter(Gate=equals_2.Equality, Stream0=data_31, Stream1=concat_2)  # -> flatten(Stream)
filter_10 = StreamFilter(
    Gate=equals_2.Equality,
    Stream0=ColourSwatch(SwatchColor=RGB(255, 255, 255)),
    Stream1=ColourSwatch(SwatchColor=RGB(10, 10, 10)))
justified_text = JustifiedText3d(
    Location=gate_19.Target1,
    Text=flatten(filter_9),
    Size=Slider(0.6919, range=0..1),
    Color=filter_10,
    HorizontalAlignment=1,
    VerticalAlginment=Slider(2, range=0..10),
    UseMeshes=False,
    Bake=False)
preview = CustomPreview(Geometry=gate_20.Target1, Material=ColourSwatch(SwatchColor=RGB(0, 0, 0)))

# ---- group: Preview
data_44 = Data(gate_20.Target1)

# ----
faceb = FaceBoundaries(Mesh=data_44)
previewlw = CustomPreviewLineweights(Geometry=faceb, Shader=ColourSwatch(SwatchColor=RGB(0, 0, 0)), Thickness=Slider(2, range=0..10), Absolute=False)

# ----
# Colourize Heights
number_slider_11 = Slider(4, range=0..10)
wbedges_2 = WeaverbirdsMeshEdges(MeshOrPolylines=pshift_9)
partition = PartitionList(List=wbedges_2, Size=number_slider_11)
curvepoint_9 = PointOnCurve(partition, parameter=0.5)
pdecon_3 = Deconstruct(Point=curvepoint_9)  # -> XComponent, YComponent, ZComponent
sort_9 = SortList(Keys=pdecon_3.ZComponent, ValuesA=partition)  # -> Keys, ValuesA
item_24 = ListItem(List=sort_9.ValuesA, Index=Slider(1, range=0..1), Wrap=True)  # -> flatten(Item)
len_6 = Length(Curve=item_24)
round_2_decimal_5 = Round2Decimal(L=len_6)
data_45 = Data(round_2_decimal_5)
cset_18 = CreateSet(List=data_45)  # -> Set, Map
lng_24 = ListLength(List=cset_18.Set)
div_6 = DivideDomain(Domain=Slider(225, range=0..1000), Count=lng_24)
dedomain_6 = DeconstructDomain(Domain=div_6)  # -> Start, flatten(End)
rgb_6 = ColourRGB(Alpha=255, Red=0, Green=dedomain_6.End, Blue=dedomain_6.End)  # -> flatten(Colour)
replace_17 = ReplaceMembers(Set=data_45, Find=cset_18.Set, Replace=rgb_6)
mcol_2 = MeshColours(Mesh=simplify(graft(pshift_9)), Colours=simplify(graft(replace_17)))
gate_21 = StreamGate(Stream=mcol_2, Gate=replace_2)  # -> Target0, flatten(Target1)
gate_22 = StreamGate(Stream=prot_2, Gate=replace_2)  # -> Target0, flatten(Target1)
data_46 = Data(flatten(round_2_decimal_5))
justified_text_2 = JustifiedText3d(
    Location=gate_22.Target1,
    Text=data_46,
    Size=Slider(0.6919, range=0..1),
    Color=ColourSwatch(SwatchColor=RGB(255, 255, 255)),
    HorizontalAlignment=1,
    VerticalAlginment=Slider(2, range=0..10),
    UseMeshes=False,
    Bake=False)
preview_2 = CustomPreview(Geometry=gate_21.Target1, Material=ColourSwatch(SwatchColor=RGB(0, 0, 0)))

# ---- group: Preview
data_47 = Data(gate_21.Target1)

# ----
faceb_2 = FaceBoundaries(Mesh=data_47)
previewlw_2 = CustomPreviewLineweights(Geometry=faceb_2, Shader=ColourSwatch(SwatchColor=RGB(0, 0, 0)), Thickness=Slider(2, range=0..10), Absolute=False)

# ----
# Mesh Accuracy Anaylsis
number_slider_12 = Slider(0, range=0..1)
item_25 = ListItem(List=sort_9.ValuesA, Index=number_slider_12, Wrap=True)  # -> flatten(Item)
len_7 = Length(Curve=item_25)
round_2_decimal_6 = Round2Decimal(L=len_7)
data_48 = Data(flatten(round_2_decimal_6))
nullrep_3 = ReplaceNulls(Items=data_48, Replacements=Slider(0, range=0..100))  # -> Items, Count
cset_19 = CreateSet(List=nullrep_3.Items)  # -> Set, Map
sort_10 = SortList(Keys=cset_19.Set)  # -> Keys, ValuesA
rgb_7 = ColourRGB(Alpha=255, Red=Slider(225, range=0..1000), Green=0, Blue=0)  # -> flatten(Colour)
rgb_8 = ColourRGB(Alpha=255, Red=0, Green=Slider(225, range=0..1000), Blue=0)  # -> flatten(Colour)
round_2_decimal_7 = Round2Decimal(L=sort_10.Keys)
merge_33 = Merge(Data1=Toggle(True), Data2=Toggle(False))
merge_34 = Merge(Data1=rgb_8, Data2=rgb_7)
panel_16 = Panel(round_2_decimal_7)
equals_3 = Equality(FirstNumber=panel_16, SecondNumber=panel_target_width)  # -> Equality, Inequality
replace_18 = ReplaceMembers(Set=equals_3.Equality, Find=merge_33, Replace=merge_34)
panel_17 = Panel(replace_18)
replace_19 = ReplaceMembers(Set=nullrep_3.Items, Find=panel_16, Replace=panel_17)
mcol_3 = MeshColours(Mesh=simplify(graft(pshift_9)), Colours=simplify(graft(replace_19)))
gate_23 = StreamGate(Stream=mcol_3, Gate=replace_3)  # -> Target0, Target1
demesh_2 = DeconstructMesh(Mesh=gate_23.Target1)  # -> Vertices, Faces, Colours, Normals
item_26 = ListItem(List=demesh_2.Vertices, Index=0, Wrap=True)  # -> Item, Item1, Item2, Item3
facen = FaceNormals(Mesh=gate_23.Target1)  # -> Centers, Normals
merge_35 = Merge(Data1=item_26.Item, Data2=item_26.Item2)
neg_7 = Negative(Value=Slider(1.92, range=0..100))
line_6 = LineSDL(Start=merge_35, Direction=facen.Normals, Length=neg_7)
swatch = ColourSwatch(SwatchColor=RGB(0, 0, 0))
gate_24 = StreamGate(Stream=prot_2, Gate=replace_3)  # -> Target0, flatten(Target1)
justified_text_3 = JustifiedText3d(
    Location=gate_24.Target1,
    Text=data_48,
    Size=Slider(0.6919, range=0..1),
    Color=ColourSwatch(SwatchColor=RGB(255, 255, 255)),
    HorizontalAlignment=1,
    VerticalAlginment=Slider(2, range=0..10),
    UseMeshes=False,
    Bake=False)
preview_3 = CustomPreview(Geometry=gate_23.Target1, Material=ColourSwatch(SwatchColor=RGB(0, 0, 0)))
preview_4 = CustomPreview(Geometry=line_6, Material=swatch)
vdisex = VectorDisplayEx(Point=merge_35, Vector=line_6, Colour=swatch, Width=Slider(0.75109, range=0..1))

# ---- group: Preview
data_49 = Data(gate_23.Target1)

# ----
faceb_3 = FaceBoundaries(Mesh=data_49)
previewlw_3 = CustomPreviewLineweights(Geometry=faceb_3, Shader=ColourSwatch(SwatchColor=RGB(0, 0, 0)), Thickness=Slider(2, range=0..10), Absolute=False)

# ==== cluster SortSurfaces
B = ClusterInput()
debrep = DeconstructBrep(Brep=B)  # -> Faces, Edges, Vertices
area = Area(Geometry=debrep.Faces)  # -> Area, Centroid
srf_cp = SurfaceClosestPoint(Point=area.Centroid, Surface=debrep.Faces)  # -> Point, UVPoint, Distance
custom_order = ClusterInput()
evalsrf = EvaluateSurface(Surface=debrep.Faces, Point=srf_cp.UVPoint)  # -> Point, Normal, UDirection, VDirection, Frame
pdecon = Deconstruct(Point=evalsrf.Point)  # -> XComponent, YComponent, ZComponent
sort = SortList(Keys=pdecon.ZComponent, ValuesA=debrep.Faces)  # -> Keys, ValuesA
merge = Merge(Data1=Slider(-1, range=-1..0), Data2=Slider(0, range=0..100))
item = ListItem(List=sort.ValuesA, Index=Slider(-1, range=-1..0), Wrap=True)
item_2 = ListItem(List=sort.ValuesA, Index=0, Wrap=True)
cull_i = CullIndex(List=sort.ValuesA, Indices=merge, Wrap=True)
item_3 = ListItem(List=sort.ValuesA, Index=custom_order, Wrap=True)
join = BrepJoin(Breps=cull_i)  # -> Breps, Closed
custom = Data(item_3)
lowest = Data(item_2)
highest = Data(item)
custom_2 = ClusterOutput(custom)
remove_cap = Data(join.Breps)
lowest_2 = ClusterOutput(lowest)
highest_2 = ClusterOutput(highest)
remove_cap_2 = ClusterOutput(remove_cap)

# ==== cluster Round2Decimal
before = Slider(1, range=0..5)
after = Slider(2, range=0..5)
L = ClusterInput()
ghpython_script = GhPythonScript(active=Toggle(True), L=L, before=before, after=after)  # -> out, simplify(flatten(R)), active; inputs L: list, before: Int32, after: Int32
# ---------- ghpython_script: Python ----------
if active:

    L = [(eval("'{:0" + str(before+after+1) + "." + str(after) +"f}'.format(float(" + str(num) + "))")) for num in L]

    R = L

    active = True
else:
    active = False
# ---------- end ghpython_script ----------
R = ClusterOutput(ghpython_script.R)
